# Grasshopper definition Ball-genetic.gh (Grasshopper 1.0.7)

trigger = Trigger(Interval=10, TimerInterval=10, Target=c_script)  # disabled
panel = Panel("regular solution")
c_script = CSharpScript(reset=Button())  # -> out, A, B; inputs reset: Boolean
# ---------- c_script: C# ----------
    if(init || reset)
    {

      p = new Population();

      init = false;
      reset = false;

      //create 3 referent points
      Pa = new Point3d(rnd.Next(50), rnd.Next(50), 0);
      Pb = new Point3d(rnd.Next(50), rnd.Next(50), 0);
      Pc = new Point3d(rnd.Next(50), rnd.Next(50), 0);

    }
    p.evolve();

    //clear old result
    circles.Clear();
    Npoints.Clear();

    for (int i = 0; i < p.pop.Length; i++)
    {
      p.pop[i].draw(i);
    }

    //output
    A = circles;
    B = Npoints;
# ---------- c_script: C# additional code ----------
  public static Random rnd = new Random();

  public static double x = 100.0;
  public static double y = 100.0;
  public static double radius = 100.0;

  public static Point3d Pa;
  public static Point3d Pb;
  public static Point3d Pc;

  public static Point3d NPa;
  public static Point3d NPb;
  public static Point3d NPc;

  public static List<Point3d> Npoints = new List<Point3d>();

  public static List<Circle> circles = new List<Circle>();
  public static List<Point3d> points = new List<Point3d>();
  public Genotype a;
  public Phenotype b;

  public static bool init = true;

  public static int popNumber = 100;

  public static int numRows = (int) Math.Sqrt(popNumber);//10;

  public static Population p;

  //Genotype
  public class Genotype
  {
    public int [] genes;

    public Genotype()

    {
      genes = new int[3];
      for(int i = 0;i < genes.Length;i++)
      {
        genes[i] = (int) rnd.Next(256);
      }
    }

    public void mutate()
    {
      for(int i = 0;i < genes.Length;i++)
      {
        if(rnd.Next(100) < 5)
        {
          genes[i] = (int) rnd.Next(256);
        }
      }
    }

  }

  //Phenotype
  public class Phenotype
  {
    public double i_x;//centerx
    public double i_y;//centery
    public double i_radius;

    public Phenotype(Genotype g)
    {
      //remap 256-->100
      i_x = g.genes[0] * x / 256;
      i_y = g.genes[1] * y / 256;
      i_radius = g.genes[2] * radius / 256;
    }
    public void draw(int i)
    {
      Circle circle = new Circle(
        new Point3d (i_x, i_y, 0)
        , i_radius);

      //move objects as array
      Transform trans = Transform.Translation(x * (i % numRows), y * (i / numRows), 0);

      //array referent points
      NPa = new Point3d(Pa + new Vector3d (x * (i % numRows), y * (i / numRows), 0));
      NPb = new Point3d(Pb + new Vector3d (x * (i % numRows), y * (i / numRows), 0));
      NPc = new Point3d(Pc + new Vector3d (x * (i % numRows), y * (i / numRows), 0));

      Npoints.Add(NPa);
      Npoints.Add(NPb);
      Npoints.Add(NPc);

      circle.Transform(trans);
      circles.Add(circle);
    }

    public double evaluate()
    {
      //near circle curve get higher score
      //far circle curve get lower score

      double fitness = 0.0;
      Point3d center = new Point3d(i_x, i_y, 0);

      fitness -= Math.Pow((i_radius - center.DistanceTo(Pa)), 2);
      fitness -= Math.Pow((i_radius - center.DistanceTo(Pb)), 2);
      fitness -= Math.Pow((i_radius - center.DistanceTo(Pc)), 2);

      return fitness;
    }
  }
  //individual
  public class Individual : IComparable
  {
    public Genotype i_geno;
    public Phenotype i_pheno;
    public double i_fitness;

    public Individual()
    {
      i_geno = new Genotype();
      i_pheno = new Phenotype(i_geno);
      i_fitness = 0;
    }

    public void draw(int i)
    {
      i_pheno.draw(i);
    }
    public void evaluate()
    {
      i_fitness = i_pheno.evaluate();
    }

    public int CompareTo (object obj)
    {
      Individual iToCompare = (Individual) obj;

      if(i_fitness < iToCompare.i_fitness)
      {
        return -1;
      }
      else if(i_fitness > iToCompare.i_fitness)
      {
        return 1;
      }
      return 0;
    }

  }
  //function
  public static Individual breed (Individual a, Individual b)
  {
    Individual c = new Individual();
    c.i_geno = crossover(a.i_geno, b.i_geno);//crossover
    c.i_geno.mutate();//mutate

    c.i_pheno = new Phenotype(c.i_geno);
    return c;
  }

  public static Genotype crossover(Genotype a, Genotype b)
  {
    Genotype c = new Genotype();
    for(int i = 0;i < c.genes.Length;i++)
    {
      if(rnd.Next(100) < 50)
      {
        c.genes[i] = a.genes[i];
      }
      else
      {
        c.genes[i] = b.genes[i];
      }
    }
    return c;
  }
  //population

  public class Population
  {

    public Individual [] pop;

    public Population()
    {
      pop = new Individual[popNumber];

      for(int i = 0;i < popNumber;i++)
      {
        pop[i] = new Individual();
        pop[i].evaluate();
      }
      //array to less fit to most fit individual
      Array.Sort(pop);

    }

    public void evolve()
    {
      //a=dad,b=mom,x=offspring
      Individual a,b,x;
      for(int i = 0;i < popNumber;i++)
      {
        a = selectIndividual();
        b = selectIndividual();

        //breed
        x = breed(a, b);

        //replace worstindividual
        pop[0] = x;
        pop[0].evaluate();
        Array.Sort(pop);

      }
    }
    public Individual selectIndividual()
    {//1e-3=0.0001
      //high possibility to near 1 more than 0= most fitness
      int which = (int) Math.Floor(((double) popNumber - 1e-3) * (1.0 - Math.Pow((rnd.NextDouble()), 2)));
      return pop[which];
    }
  }
# ---------- end c_script ----------
panel_2 = Panel(c_script.out)
trigger_2 = Trigger(Interval=10, TimerInterval=10, Target=c_script_2)  # disabled
panel_3 = Panel("extra solution")
c_script_2 = CSharpScript(reset=Button(), num=Slider(5, range=1..5))  # -> out, A, B, C; inputs reset: Boolean, num: Int32
# ---------- c_script_2: C# ----------
    if(init || reset)
    {
      pts.Clear();

      for (int m = 0; m < num;m++) {
        refpoint = new Point3d(rnd.Next(100), rnd.Next(100), rnd.Next(100));
        pts.Add(refpoint);
      }
      p = new Population(num);

      init = false;
      reset = false;

    }
    p.evolve(num);

    //clear old result
    spheres.Clear();
    planets.Clear();


    for (int i = 0; i < p.pop.Length; i++)
    {
      p.pop[i].draw(i, num);
    }


    //output
    A = spheres;
    B = pts;
    C = planets;
# ---------- c_script_2: C# additional code ----------
  public static Random rnd = new Random();

  public static double x = 200.0;
  public static double y = 200.0;
  public static double z = 200.0;
  public static double radius = 100.0;

  public static Point3d refpoint;
  public static List<Point3d> pts = new List<Point3d>();

  public static List<Sphere> planets = new List<Sphere>();

  public static List<Sphere> spheres = new List<Sphere>();
  public static List<Point3d> points = new List<Point3d>();
  public Genotype a;
  public Phenotype b;

  public static bool init = true;

  public static int popNumber = 9;

  public static int numRows = (int) Math.Sqrt(popNumber);//10;

  public static Population p;

  //Genotype
  public class Genotype
  {
    public int [] genes;

    public Genotype()

    {
      genes = new int[4];
      for(int i = 0;i < genes.Length;i++)
      {
        genes[i] = (int) rnd.Next(256);
      }
    }

    public void mutate()
    {
      for(int i = 0;i < genes.Length;i++)
      {
        if(rnd.Next(100) < 5)
        {
          genes[i] = (int) rnd.Next(256);
        }
      }
    }

  }

  //Phenotype
  public class Phenotype
  {
    public double i_x;//centerx
    public double i_y;//centery
    public double i_z;//centerz
    public double i_radius;

    public Phenotype(Genotype g)
    {
      //remap 256-->100
      i_x = g.genes[0] * x / 256;
      i_y = g.genes[1] * y / 256;
      i_y = g.genes[2] * z / 256;
      i_radius = g.genes[3] * radius / 256;
    }
    public void draw(int i, int num)
    {
      Sphere sphere = new Sphere(
        new Point3d (i_x, i_y, i_z)
        , i_radius);

      //move objects as array
      Transform trans = Transform.Translation(x * (i % numRows), y * (i / numRows), 0);

      //Add sphere size according to how far from center
      Point3d center = new Point3d(i_x, i_y, 0);

      for (int l = 0; l < num;l++) {
        Sphere planet = new Sphere(pts[l]
          , center.DistanceTo(pts[l]) / 5);
        planet.Transform(trans);
        planets.Add(planet);
      }

      sphere.Transform(trans);
      spheres.Add(sphere);
    }

    public double evaluate(int num)
    {
      //near circle curve get higher score
      //far circle curve get lower score

      double fitness = 0.0;

      Point3d center = new Point3d(i_x, i_y, i_z);

      for (int h = 0; h < num;h++) {
        fitness -= Math.Pow((i_radius - center.DistanceTo(pts[h])), 2);
      }
      return fitness;
    }
  }
  //individual
  public class Individual : IComparable
  {
    public Genotype i_geno;
    public Phenotype i_pheno;
    public double i_fitness;

    public Individual()
    {
      i_geno = new Genotype();
      i_pheno = new Phenotype(i_geno);
      i_fitness = 0;
    }

    public void draw(int i, int num)
    {
      i_pheno.draw(i, num);
    }
    public void evaluate(int num)
    {
      i_fitness = i_pheno.evaluate(num);
    }

    public int CompareTo (object obj)
    {
      Individual iToCompare = (Individual) obj;

      if(i_fitness < iToCompare.i_fitness)
      {
        return -1;
      }
      else if(i_fitness > iToCompare.i_fitness)
      {
        return 1;
      }
      return 0;
    }

  }
  //function
  public static Individual breed (Individual a, Individual b)
  {
    Individual c = new Individual();
    c.i_geno = crossover(a.i_geno, b.i_geno);//crossover
    c.i_geno.mutate();//mutate

    c.i_pheno = new Phenotype(c.i_geno);
    return c;
  }

  public static Genotype crossover(Genotype a, Genotype b)
  {
    Genotype c = new Genotype();
    for(int i = 0;i < c.genes.Length;i++)
    {
      if(rnd.Next(100) < 50)
      {
        c.genes[i] = a.genes[i];
      }
      else
      {
        c.genes[i] = b.genes[i];
      }
    }
    return c;
  }
  //population

  public class Population
  {

    public Individual [] pop;

    public Population(int num)
    {
      pop = new Individual[popNumber];

      for(int i = 0;i < popNumber;i++)
      {
        pop[i] = new Individual();
        pop[i].evaluate(num);
      }
      //array to less fit to most fit individual
      Array.Sort(pop);

    }

    public void evolve(int num)
    {
      //a=dad,b=mom,x=offspring
      Individual a,b,x;
      for(int i = 0;i < popNumber;i++)
      {
        a = selectIndividual();
        b = selectIndividual();

        //breed
        x = breed(a, b);

        //replace worstindividual
        pop[0] = x;
        pop[0].evaluate(num);
        Array.Sort(pop);

      }
    }
    public Individual selectIndividual()
    {//1e-3=0.0001
      //high possibility to near 1 more than 0= most fitness
      int which = (int) Math.Floor(((double) popNumber - 1e-3) * (1.0 - Math.Pow((rnd.NextDouble()), 2)));
      return pop[which];
    }
  }
# ---------- end c_script_2 ----------
volume = Volume(Geometry=c_script_2.C)  # -> Volume, Centroid
panel_4 = Panel(c_script_2.out)
bnd = Bounds(Numbers=volume.Volume)
dedomain = DeconstructDomain(Domain=bnd)  # -> Start, End
gradient = Gradient(
    LowerLimit=dedomain.Start,
    UpperLimit=dedomain.End,
    Parameter=volume.Volume,
    stops=[0.00124: RGB(255, 255, 99), 0.34: RGB(199, 255, 223), 0.639: RGB(84, 203, 192), 1: RGB(192, 192, 255)])
preview = CustomPreview(Geometry=c_script_2.C, Material=gradient)
